# Dynamo graph Indexed Family Instances.dyn

family_type_selector = FamilyTypeSelector(index=17)
string = StringInput("increment")
family_instance_creator_indexed = Custom[Family Instance Creator - Indexed](typ=family_type_selector, param=string)
number = DoubleInput(1)
number_slider = DoubleSliderInput(20, range=0..20)
number_2 = DoubleInput(1)
number_sequence = BuildSeq(number, number_slider, number_2)
map = Map(family_instance_creator_indexed, number_sequence)
